# Grasshopper definition Cantilever.gh (Grasshopper 1.0.8)
# plug-ins: FEMur

number_slider = Slider(4, range=0..10)
subtraction = Subtraction(A=number_slider, B=1)
division = Division(A=Slider(1000, range=0..1000), B=subtraction)
unit_x = UnitX(Factor=division)
point = Point(Point(0, 0, 0))
linear_array = LinearArray(Geometry=point, Direction=unit_x, Count=number_slider)  # -> Geometry, Transform
list_item = ListItem(List=linear_array.Geometry, Index=subtraction, Wrap=True)
crosssection_h_femur = CrossSectionHFEMur(Id=0, Name="H-Section", B=200, H=100, T_f=8, T_w=12, R=6)
negative = Negative(Value=Slider(5000, range=0..5000))
material_femur = MaterialFEMur(Id=0)
polyline = PolyLine(Vertices=linear_array.Geometry, Closed=False)
unit_z = UnitZ(Factor=negative)
beamelement = BeamElement(Polylines=polyline, Material=material_femur, CrossSection=crosssection_h_femur, BetaAngle=0)  # -> BeamElements, Points
pointload_femur = PointLoadFEMur(Points=list_item, Force=unit_z, Moment=Vector(0, 0, 0))
support_femur = SupportFEMur(Points=point, RX=True, RY=True, RZ=True, UX=True, UY=True, UZ=True)
assemblemodel_femur = AssembleModelFEMur(
    Elements=beamelement.BeamElements,
    Supports=support_femur,
    Loads=pointload_femur,
    IsDisplayTabExpanded=True,
    LocalAxisScale=0.3,
    ShowCrossSection=False,
    ShowElementId=False,
    ShowLoad=False,
    ShowLocalAxis=False,
    ShowNodeId=False,
    ShowSupport=True)
linearstaticsolver_femur = LinearStaticSolverFEMur(Model=assemblemodel_femur, Run=True)  # -> AnalyzedModel, Info, Warnings
deconstructresult_femur = DeconstructResultFEMur(AnalyzedModel=linearstaticsolver_femur.AnalyzedModel)  # -> NodalDisplacements, ElementStresses, DisplacementValues, StressInfo
sectionforceview_femur = SectionForceViewFEMur(
    AnalyzedModel=linearstaticsolver_femur.AnalyzedModel,
    Scale=1,
    IsSectionForcesTabExpanded=True,
    SelectedForceType=5,
    SelectedForceUnit=1,
    SelectedLengthUnit=1,
    ShowFilled=True,
    ShowLegend=True,
    ShowNumbers=True)
